# Grasshopper definition GetData.gh (Grasshopper 1.0.8)
# plug-ins: RhinoCodePluginGH, Redback-Beta.GH

geo = Geometry(<brep referenced from the Rhino model>)  # disabled
object = ModelObject(Object=geo)  # -> Object, Geometry, Name, Layer, Visibility, Display, Drafting, Render; disabled
layer_path = LayerPath(Layer=object.Layer)  # disabled
objects = QueryModelObjects(Layer=layer_path, Locked=True, Hidden=True, AutoUpdateState=True)  # disabled
item = ListItem(List=objects, Index=[0, 1, 2, 3], Wrap=True)  # disabled
panel = Panel("id")  # disabled
u_text = UserText(Content=item, Keys=panel, UserTextMode=1)  # -> Content, Values; disabled
panel_2 = Panel(u_text.Values)  # disabled
object_2 = ModelObject(Object=graft(item))  # -> Object, Geometry; disabled
details = ContentDetails(Content=graft(item))  # -> Content, Id, Path, Attributes; disabled
panel_3 = Panel("{}")  # disabled
toggle = BooleanToggle(False)  # disabled
serialize_geometry = SerializeGeometry(Geometry=object_2.Geometry, PR=panel_3)  # disabled
line = Line(Line((23.43682309, -15.94068946, 6.615565578), (27.63925223, 10.00088694, 0.8440000029)))  # disabled
py3 = Python3Script(u=toggle, x=flatten(details.Id), z=flatten(u_text.Values), y=flatten(serialize_geometry))  # -> out, a; inputs x: list, z: list, y: list; disabled
# ---------- py3: Python ----------
import requests
a = []
if u:
    if not z:
        z = [None]*len(x)
    for u,v,w in zip(x,z,y):
        data = {"enabled":True, "identifier":u, "name":"Floor Slab"}

        if v:
            data["id"]= int(v)
        print(data)
        if "id" in data:
            r = requests.put("https://archmanucox.pythonanywhere.com/bimverse/nodes/%s/"%(int(v)), data=data)
        else:
            r = requests.post("https://archmanucox.pythonanywhere.com/bimverse/nodes/", data=data)
        print(r)
        #print(r.text)
        print(r.json())
        a.append(r.json()["id"])
# ---------- end py3 ----------
panel_4 = Panel("{}")  # disabled
geo_2 = Geometry([<curve referenced from the Rhino model> x28])  # disabled
py3_2 = Python3Script(RUN=Toggle(True))  # -> out, ids, identifier
# ---------- py3_2: Python ----------
import requests
import json

if RUN:
    r = requests.get("https://archmanucox.pythonanywhere.com/bimverse/nodes/")
    data = r.json()
    print(data)
    identifier = list(map(lambda x: x["identifier"], data))
    ids = list(map(lambda x: x["id"], data))
    #data = list(map(lambda x: json.dumps(x),data))
    #J = data
# ---------- end py3_2 ----------
panel_5 = Panel("id")  # disabled
geo2arch = Geo2Arch(Geometry=line, Properties="{}")  # disabled
toggle_2 = BooleanToggle(False)  # disabled
u_text_2 = UserText(Content=graft(item), Keys=panel_5, Values=graft(py3.a), UserTextMode=1)  # -> flatten(Content), Keys, Values; disabled
serialize_geometry_2 = Python3Script(GE=geo_2, PR=panel_4)  # -> out, JO; inputs GE: GeometryBase; disabled
# ---------- serialize_geometry_2: Python ----------
import json
if not PR:
    PR = "{}"

PR = json.loads(PR)

data = json.loads(GE.ToJSON(None))
data["properties"] = PR
#print(list(data))

JO = json.dumps(data)
# ---------- end serialize_geometry_2 ----------
serialize_geometry_3 = SerializeGeometry(Geometry=geo_2, PR=panel_4)  # disabled
tmatch = MatchText(Text=py3_2.identifier, RegEx="[a-z 0-9]{8}", Case=True)
panel_6 = Panel("2")  # disabled
list = ValueList({"Rhino-Medium", "Rhino-Detailed", "LaserCutter"}, selected="Rhino-Medium")  # disabled
information = ContentInformation(Content=geo_2)  # -> Content, Parent, Name, Tags; disabled
panel_7 = Panel(py3.a)  # disabled
details_2 = ContentDetails(Content=geo_2)  # -> Content, Id, Path, Attributes; disabled
dispatch = Dispatch(List=py3_2.ids, DispatchPattern=tmatch)  # -> ListA, ListB
dispatch_2 = Dispatch(List=py3_2.identifier, DispatchPattern=tmatch)  # -> ListA, ListB
cache = ContentCache(Content=u_text_2.Content, Action=toggle_2)  # disabled
item_2 = ListItem(List=dispatch.ListA, Index=0, Wrap=True)
item_3 = ListItem(List=dispatch_2.ListA, Index=0, Wrap=True)
py3_3 = Python3Script(index=panel_6, x=list)  # -> out, a; disabled
# ---------- py3_3: Python ----------
# r: requests
import json
import requests

r = requests.get("http://archmanucox.pythonanywhere.com/bimverse/nodes/%s.json"%index)
data = r.json()

a = []

for i in data["geometryObjects"]:   
    if i["name"] == x:
        if type(i["geometry"]) == type([]):
            for g in i["geometry"]:
                a.append(json.dumps(g))
                appendObject = "list"
        else:
            appendObject= json.dumps(i["geometry"])

if not appendObject:
    appendObject= json.dumps(data[index]["geometryObjects"][0]["geometry"])
if appendObject != "list":
    a.append(appendObject)
# ---------- end py3_3 ----------
py3_4 = Python3Script()  # -> out, N, E; disabled
# ---------- py3_4: Python ----------
# r: requests
import json
import requests
import ghpythonlib as ghp

r = requests.get("http://localhost:8000/bimverse/edges/")
data = r.json()

#print(data)
nodes = []
edges = []
for i in data:
    if i["nodeObject_from"] not in nodes:
        nodes.append(i["nodeObject_from"])
    if i["nodeObject_to"] not in nodes:
        nodes.append(i["nodeObject_to"])
    f = nodes.index(i["nodeObject_from"])
    t = nodes.index(i["nodeObject_to"])
    edges.append([f,t])

N = nodes
E = ghp.treehelpers.list_to_tree(edges)
# ---------- end py3_4 ----------
object_3 = ModelObject(Object=item_3)  # -> Object, Geometry, Name, Layer, Visibility, Display, Drafting, Render
deserialize_geometry_json = DeserializeGeometryJSON(Geometry=py3_3.a)  # -> JSONObject, PR; disabled
py3_5 = Python3Script()  # -> out, a; disabled
# ---------- py3_5: Python ----------
import requests

r = requests.get("https://archmanucox.pythonanywhere.com/bimverse/nodes/169.json")
print(r.json())

data = {"name":"FromGHPY2","enabled":True}
#postR = requests.post("https://archmanucox.pythonanywhere.com/bimverse/nodes/", data=data)

putR = requests.put("https://archmanucox.pythonanywhere.com/bimverse/nodes/171/", data=data)

print(putR.json())
# ---------- end py3_5 ----------
deserialize_geometry_json_2 = Python3Script(JO=py3_3.a)  # -> out, GE, PR; inputs JO: String; disabled
# ---------- deserialize_geometry_json_2: Python ----------
import json
import Rhino as rh

PR = json.dumps(json.loads(JO)["properties"])

GE = rh.Geometry.GeometryBase.FromJSON(JO)
# ---------- end deserialize_geometry_json_2 ----------
lng = ListLength(List=py3_4.N)  # disabled
geo_3 = Geometry(deserialize_geometry_json.JSONObject)  # disabled
pop2d = Populate2D(Region={Plane=PlaneXY(0, 0, 0), Size=Domain2(u=0..20, v=0..10)}, Count=lng, Seed=1)  # disabled
object_4 = ModelObject(Geometry=geo_3)  # -> Object, Geometry, Name, Layer, Visibility, Display, Drafting, Render; disabled
item_4 = ListItem(List=pop2d, Index=py3_4.E, Wrap=True)  # disabled
u_text_3 = UserText(Content=graft(object_3.Object), Keys="id", Values=graft(item_2), UserTextMode=1)  # -> flatten(Content), Keys, Values
toggle_3 = BooleanToggle(False)  # disabled
pline = PolyLine(Vertices=item_4, Closed=False)  # disabled
cache_2 = ContentCache(Content=object_4.Object, Action=toggle_3)  # disabled
panel_8 = Panel(item_4)  # disabled
cache_3 = ContentCache(Content=u_text_3.Content, Action=Toggle(True))
panel_9 = Panel(object_3.Object)
