# Grasshopper definition GetData2.ghx (Grasshopper 1.0.8)
# plug-ins: RhinoCodePluginGH, Rhino.Inside for Autodesk Revit, Redback-Beta.GH

geo = Geometry(<brep referenced from the Rhino model>)  # disabled
object = ModelObject(Object=geo)  # -> Object, Geometry, Name, Layer, Visibility, Display, Drafting, Render; disabled
layer_path = LayerPath(Layer=object.Layer)  # disabled
graphical_element = GraphicalElement([<wall referenced from the Revit model> x2])
objects = QueryModelObjects(Layer=layer_path, Locked=True, Hidden=True, AutoUpdateState=True)  # disabled
py3 = Python3Script(x=graphical_element)  # -> out, a
# ---------- py3: Python ----------
import clr

# add reference to base system types e.g. Enum
clr.AddReference('System.Core')

# add reference to API provided by Rhino.Inside.Revit
clr.AddReference('RhinoInside.Revit')

# add reference to Revit API (two DLLs)
clr.AddReference('RevitAPI') 
clr.AddReference('RevitAPIUI')
# from System.Core DLL
from System import Enum, Action

# Rhino.Inside.Revit API
import RhinoInside as ri
from RhinoInside.Revit import Revit, Convert



# Revit API
from Autodesk.Revit import DB
from Autodesk.Revit import UI


locationCurves = x.Location.Curve
print(locationCurves)
print(dir(locationCurves))

a = ri.Revit.Convert.Geometry.GeometryDecoder.ToCurve(locationCurves)
# ---------- end py3 ----------
geometry = ElementGeometry(Elements=graphical_element)
item = ListItem(List=objects, Index=[0, 1, 2, 3], Wrap=True)  # disabled
panel = Panel(py3.a)
panel_2 = Panel("{}")  # disabled
geo_2 = Geometry([<curve referenced from the Rhino model> x28])  # disabled
panel_3 = Panel("id")  # disabled
expression = Expression(Expression="Format(\"{0}, {1}\", x, y)")
serialize_geometry = Python3Script(GE=geo_2, PR=panel_2)  # -> out, JO; inputs GE: GeometryBase; disabled
# ---------- serialize_geometry: Python ----------
import json
if not PR:
    PR = "{}"

PR = json.loads(PR)

data = json.loads(GE.ToJSON(None))
data["properties"] = PR
#print(list(data))

JO = json.dumps(data)
# ---------- end serialize_geometry ----------
categories = BuiltInCategories("autodesk.revit.category.local:levels-1.0.0", SearchPattern="Levels")
u_text = UserText(Content=item, Keys=panel_3, UserTextMode=1)  # -> Content, Values; disabled
panel_4 = Panel(u_text.Values)  # disabled
geo_3 = Geometry(<brep referenced from the Rhino model>)
serialize_geometry_2 = SerializeGeometry(Geometry=geo_2, PR=panel_2)  # disabled
object_2 = ModelObject(Object=graft(item))  # -> Object, Geometry; disabled
details = ContentDetails(Content=graft(item))  # -> Content, Id, Path, Attributes; disabled
panel_5 = Panel("{}")  # disabled
panel_6 = Panel("2")  # disabled
panel_7 = Panel("HostID")
object_3 = ModelObject(Object=geo_3)  # -> Object, Geometry, Name, Layer, Visibility, Display, Drafting, Render
categories_2 = BuiltInCategories("autodesk.revit.category.local:rooms-1.0.0", SearchPattern="Room")
list = ValueList({"Rhino-Medium", "Rhino-Detailed", "LaserCutter"}, selected="Rhino-Medium")  # disabled
information = ContentInformation(Content=geo_2)  # -> Content, Parent, Name, Tags; disabled
details_2 = ContentDetails(Content=geo_2)  # -> Content, Id, Path, Attributes; disabled
toggle = BooleanToggle(False)  # disabled
serialize_geometry_3 = SerializeGeometry(Geometry=object_2.Geometry, PR=panel_5)  # disabled
layer_path_2 = LayerPath(Layer=object_3.Layer)  # disabled
levels = QueryLevels(BuildingStory=True)
line = Line(Line((23.43682309, -15.94068946, 6.615565578), (27.63925223, 10.00088694, 0.8440000029)))  # disabled
py3_2 = Python3Script(index=panel_6, x=list)  # -> out, a; disabled
# ---------- py3_2: Python ----------
# r: requests
import json
import requests

r = requests.get("http://archmanucox.pythonanywhere.com/bimverse/nodes/%s.json"%index)
data = r.json()

a = []

for i in data["geometryObjects"]:   
    if i["name"] == x:
        if type(i["geometry"]) == type([]):
            for g in i["geometry"]:
                a.append(json.dumps(g))
                appendObject = "list"
        else:
            appendObject= json.dumps(i["geometry"])

if not appendObject:
    appendObject= json.dumps(data[index]["geometryObjects"][0]["geometry"])
if appendObject != "list":
    a.append(appendObject)
# ---------- end py3_2 ----------
catfltr = CategoryFilter(Categories=categories, Inverted=False)
py3_3 = Python3Script(u=toggle, x=flatten(details.Id), z=flatten(u_text.Values), y=flatten(serialize_geometry_3))  # -> out, a; inputs x: list, z: list, y: list; disabled
# ---------- py3_3: Python ----------
import requests
a = []
if u:
    if not z:
        z = [None]*len(x)
    for u,v,w in zip(x,z,y):
        data = {"enabled":True, "identifier":u, "name":"Floor Slab"}

        if v:
            data["id"]= int(v)
        print(data)
        if "id" in data:
            r = requests.put("https://archmanucox.pythonanywhere.com/bimverse/nodes/%s/"%(int(v)), data=data)
        else:
            r = requests.post("https://archmanucox.pythonanywhere.com/bimverse/nodes/", data=data)
        print(r)
        #print(r.text)
        print(r.json())
        a.append(r.json()["id"])
# ---------- end py3_3 ----------
objects_2 = QueryModelObjects(Layer=layer_path_2, Locked=True, Hidden=True, AutoUpdateState=True)  # disabled
py3_4 = Python3Script(RUN=Toggle(False))  # -> out, ids, identifier
# ---------- py3_4: Python ----------
import requests
import json

if RUN:
    r = requests.get("https://archmanucox.pythonanywhere.com/bimverse/nodes/")
    data = r.json()
    print(data)
    identifier = list(map(lambda x: x["identifier"], data))
    ids = list(map(lambda x: x["id"], data))
    #data = list(map(lambda x: json.dumps(x),data))
    #J = data
# ---------- end py3_4 ----------
item_2 = ListItem(List=levels, Index=0, Wrap=True)
panel_8 = Panel("id")  # disabled
geo2arch = Geo2Arch(Geometry=line)  # disabled
catfltr_2 = CategoryFilter(Categories=categories_2, Inverted=False)
toggle_2 = BooleanToggle(False)  # disabled
elements = QueryElements(Filter=catfltr)  # -> Elements, Count
host = ElementHost(Element=elements.Elements)
param = ElementParameter(Element=graft(host), Parameter="__id")  # -> Element, Value
u_text_2 = UserText(Content=graft(item), Keys=panel_8, Values=graft(py3_3.a), UserTextMode=1)  # -> flatten(Content), Keys, Values; disabled
py3_5 = Python3Script()  # -> out, N, E; disabled
# ---------- py3_5: Python ----------
# r: requests
import json
import requests
import ghpythonlib as ghp

r = requests.get("http://localhost:8000/bimverse/edges/")
data = r.json()

#print(data)
nodes = []
edges = []
for i in data:
    if i["nodeObject_from"] not in nodes:
        nodes.append(i["nodeObject_from"])
    if i["nodeObject_to"] not in nodes:
        nodes.append(i["nodeObject_to"])
    f = nodes.index(i["nodeObject_from"])
    t = nodes.index(i["nodeObject_to"])
    edges.append([f,t])

N = nodes
E = ghp.treehelpers.list_to_tree(edges)
# ---------- end py3_5 ----------
tmatch = MatchText(Text=py3_4.identifier, RegEx="[a-z 0-9]{8}", Case=True)
item_3 = ListItem(List=objects_2, Index=[0, 1, 2, 3], Wrap=True)  # disabled
deserialize_geometry_json = DeserializeGeometryJSON(Geometry=py3_2.a)  # -> JSONObject, PR; disabled
elements_2 = QueryElements(Filter=catfltr_2)  # -> Elements, Count
graphical_element_2 = GraphicalElement([<familyinstance referenced from the Revit model> x4])
graphical_element_3 = GraphicalElement([<wall referenced from the Revit model> x6])
graphical_element_4 = GraphicalElement([<roomelement referenced from the Revit model> x4])
panel_9 = Panel(py3_3.a)  # disabled
deserialize_geometry_json_2 = Python3Script(JO=py3_2.a)  # -> out, GE, PR; inputs JO: String; disabled
# ---------- deserialize_geometry_json_2: Python ----------
import json
import Rhino as rh

PR = json.dumps(json.loads(JO)["properties"])

GE = rh.Geometry.GeometryBase.FromJSON(JO)
# ---------- end deserialize_geometry_json_2 ----------
lng = ListLength(List=py3_5.N)  # disabled
data = Data("é")
host_2 = ElementHost(Element=elements_2.Elements)
geo_4 = Geometry(deserialize_geometry_json.JSONObject)  # disabled
dispatch = Dispatch(List=py3_4.ids, DispatchPattern=tmatch)  # -> ListA, ListB
dispatch_2 = Dispatch(List=py3_4.identifier, DispatchPattern=tmatch)  # -> ListA, ListB
cache = ContentCache(Content=u_text_2.Content, Action=toggle_2)  # disabled
panel_11 = Panel("""Name
Number""")
passport = ElementPassport(Element=graft(elements.Elements))  # -> DocumentGUID, Document, UniqueID, Id
param_2 = ElementParameter(Element=graft(elements.Elements), Parameter="__id")  # -> Element, Value
pop2d = Populate2D(Region={Plane=PlaneXY(0, 0, 0), Size=Domain2(u=0..20, v=0..10)}, Count=lng, Seed=1)  # disabled
param_3 = ElementParameter(Element=graft(elements.Elements), Parameter="Name")  # -> Element, Value
rep = ReplaceText(Text=param_3.Value, Find=data, Replace="e", RecursiveReplace=False)
geometry_2 = ElementGeometry(Elements=elements.Elements)
data_2 = Data("é")
param_4 = ElementParameter(Element=graft(host_2), Parameter="__id")  # -> Element, Value
item_4 = ListItem(List=dispatch.ListA, Index=0, Wrap=True)
item_5 = ListItem(List=dispatch_2.ListA, Index=0, Wrap=True)
passport_2 = ElementPassport(Element=graft(elements_2.Elements))  # -> DocumentGUID, Document, UniqueID, Id
object_4 = ModelObject(Geometry=geo_4)  # -> Object, Geometry, Name, Layer, Visibility, Display, Drafting, Render; disabled
param_5 = ElementParameter(Element=graft(elements_2.Elements), Parameter="__id")  # -> Element, Value
item_6 = ListItem(List=pop2d, Index=py3_5.E, Wrap=True)  # disabled
param_6 = ElementParameter(Element=graft(elements_2.Elements), Parameter=panel_11)  # -> Element, Value
param_7 = ElementParameter(Element=graft(elements_2.Elements), Parameter=panel_11)  # -> Element, Value
rep_2 = ReplaceText(Text=param_7.Value, Find=data_2, Replace="e", RecursiveReplace=False)
geometry_3 = ElementGeometry(Elements=elements_2.Elements)
merge = Merge(Data1=rep)
merge_2 = Merge(Data1="Name")
expression_2 = Expression(x=passport.DocumentGUID, y=passport.Id, Expression="Format(\"{0}_{1}\", x, y)")
mesh = MeshBrep(
    Brep=geometry_2,
    Settings={GridMaxCount=0, GridMinCount=16, JaggedSeams=False, MaxEdgeLength=0, MinEdgeLength=0.0001, MinTolerance=0, Refine=True, RefineAngle=0, RelativeTolerance=0.65, SimplePlanes=True, Tolerance=0})
json = CreateJSON(Keys=merge_2, Values=merge)
object_5 = ModelObject(Object=item_5)  # -> Object, Geometry, Name, Layer, Visibility, Display, Drafting, Render
toggle_3 = BooleanToggle(False)  # disabled
pline = PolyLine(Vertices=item_6, Closed=False)  # disabled
merge_3 = Merge(Data1=rep_2)
merge_4 = Merge(Data1=panel_11)
expression_3 = Expression(x=passport_2.DocumentGUID, y=passport_2.Id, Expression="Format(\"{0}_{1}\", x, y)")
mesh_2 = MeshBrep(
    Brep=geometry_3,
    Settings={GridMaxCount=0, GridMinCount=16, JaggedSeams=False, MaxEdgeLength=0, MinEdgeLength=0.0001, MinTolerance=0, Refine=True, RefineAngle=0, RelativeTolerance=0.65, SimplePlanes=True, Tolerance=0})
mjoin = MeshJoin(Meshes=mesh)
json_2 = CreateJSON(Keys=merge_4, Values=merge_3)
u_text_3 = UserText(Content=item_3, Keys="id", UserTextMode=1)  # -> Content, Values
py3_6 = Python3Script()  # -> out, a; disabled
# ---------- py3_6: Python ----------
import requests

r = requests.get("https://archmanucox.pythonanywhere.com/bimverse/nodes/169.json")
print(r.json())

data = {"name":"FromGHPY2","enabled":True}
#postR = requests.post("https://archmanucox.pythonanywhere.com/bimverse/nodes/", data=data)

putR = requests.put("https://archmanucox.pythonanywhere.com/bimverse/nodes/171/", data=data)

print(putR.json())
# ---------- end py3_6 ----------
cache_2 = ContentCache(Content=object_4.Object, Action=toggle_3)  # disabled
mjoin_2 = MeshJoin(Meshes=mesh_2)
panel_12 = Panel(item_6)  # disabled
object_6 = ModelObject(Object=graft(item_3))  # -> Object, Geometry; disabled
details_3 = ContentDetails(Content=graft(item_3))  # -> Content, Id, Path, Attributes; disabled
long = LongestList(ListA=mjoin, ListB="{}", PaddingMode=2)  # -> ListA, ListB
long_2 = LongestList(ListA=mjoin_2, ListB="{}", PaddingMode=2)  # -> ListA, ListB
serialize_geometry_4 = SerializeGeometry(Geometry=geometry_3, PR="{}")
u_text_4 = UserText(Content=graft(object_5.Object), Keys="id", Values=graft(item_4), UserTextMode=1)  # -> flatten(Content), Keys, Values
panel_13 = Panel(u_text_3.Values)  # disabled
py3_7 = Python3Script(
    RUN=Toggle(False),
    NAME="room",
    IDENT=flatten(expression_2),
    ID=flatten(param_2.Value),
    PROPS=flatten(json),
    GEO=flatten(long.ListB))  # -> out, a; inputs IDENT: list, ID: list, PROPS: list, GEO: list
# ---------- py3_7: Python ----------
import requests
import json
a = []
if RUN:
    if not ID:
        ID = [None]*len(x)
    for u,v,w, props in zip(IDENT,ID,GEO,PROPS):
        #props = json.loads(props)
        data = {"enabled":True, "identifier":u, "name":NAME, "data":props, "project":"snowdontowers", "modularClassTags":[NAME]}

        if v:
            data["id"]= int(v)
        print(data)
        if "id" in data:
            r = requests.put("https://archmanucox.pythonanywhere.com/bimverse/nodes/%s/"%(int(v)), data=data)
        else:
            r = requests.post("https://archmanucox.pythonanywhere.com/bimverse/nodes/", data=data)
        #print(r)
        #print(r.text)
        print(r)
        node = r.json()

        print(node) 
        if node["geometryObjects"] == []:
            geometryData = {"geometry":w, "parentObject": node["id"], "name":"Rhino-Medium"}
            geomRequest = requests.post("https://archmanucox.pythonanywhere.com/bimverse/geometries/", data=geometryData)
        a.append(r.json()["id"])
# ---------- end py3_7 ----------
graft = GraftTree(Tree=py3_7.a, IncludeEmptyLists=True, IncludeNullItems=True)
py3_8 = Python3Script(
    RUN=Toggle(True),
    NAME="room",
    IDENT=flatten(expression_3),
    ID=flatten(param_5.Value),
    PROPS=flatten(json_2),
    GEO=flatten(serialize_geometry_4))  # -> out, a; inputs IDENT: list, ID: list, PROPS: list, GEO: list; same code as py3_7
graft_2 = GraftTree(Tree=py3_8.a, IncludeEmptyLists=True, IncludeNullItems=True)
cache_3 = ContentCache(Content=u_text_4.Content, Action=Toggle(True))
param_8 = ElementParameter(Element=graft(elements.Elements), Parameter="__id", Value=graft)  # -> Element, Value
param_9 = ElementParameter(Element=graft(elements_2.Elements), Parameter="__id", Value=graft_2)  # -> Element, Value
panel_14 = Panel(object_5.Object)
panel_15 = Panel(param_5.Value)
panel_16 = Panel("id")  # disabled
panel_17 = Panel("""0	1
1	0
1	2
2	1
3	0
0	3""")
panel_18 = Panel("""0	1
1	0
1	2
2	1
3	0
0	3""")
toggle_4 = BooleanToggle(False)  # disabled
u_text_5 = UserText(Content=graft(item_3), Keys=panel_16, UserTextMode=1)  # -> flatten(Content), Keys, Values; disabled
split = TextSplit(Text=panel_17, Separators="\t")
split_2 = TextSplit(Text=panel_18, Separators="\t")
cache_4 = ContentCache(Content=u_text_5.Content, Action=toggle_4)  # disabled
item_7 = ListItem(List=py3_8.a, Index=split, Wrap=True)
item_8 = ListItem(List=py3_8.a, Index=split_2, Wrap=True)
py3_9 = Python3Script(RUN=Toggle(False), name="room_connected", ids=item_7)  # -> out, a; inputs ids: list
# ---------- py3_9: Python ----------
import requests
import json
a = []
if RUN:
    data = {"nodeObject_from":ids[0],"nodeObject_to":ids[1],"name":name}
    r = requests.post("https://archmanucox.pythonanywhere.com/bimverse/edges/", data=data)
    edge = r.json()
    print(edge)
# ---------- end py3_9 ----------
py3_10 = Python3Script(RUN=Toggle(False), name="room_adjacent", ids=item_8)  # -> out, a; inputs ids: list; same code as py3_9
panel_19 = Panel(item_8)
