# Grasshopper definition diagrams.gh (Grasshopper 1.0.8)
# plug-ins: Human, Squid, Redback-Beta.GH

dpipeline = DynamicGeometryPipeline(
    LayerFilter="nodes",
    TypeFilter="Point",
    NameFilter="*",
    GroupByLayer=False,
    GroupByType=False,
    IncludeHidden=True,
    IncludeLocked=True,
    enableFullPath=False,
    listenToAttributes=True)
u_text = UserText(Content=dpipeline, UserTextMode=1)  # -> Content, Keys, Values
graft = GraftTree(Tree=dpipeline, IncludeEmptyLists=True, IncludeNullItems=True)
u_text_2 = UserText(Content=dpipeline, Keys="class", UserTextMode=1)  # -> Content, Values
u_text_3 = UserText(Content=dpipeline, Keys="label", UserTextMode=1)  # -> Content, Values
panel = Panel("""{"featureClass":{"font-size":"5"},
"geometry":{"font-size":"4"},
"node":{"font-size":"6"}
}""")
xy = XYPlane(Origin=graft(graft))
json = CreateJSON(Keys=u_text.Keys, Values=u_text.Values)  # disabled
cset = CreateSet(List=flatten(u_text_2.Values))  # -> Set, Map
read_json = ReadJSON(JSONObject=json, Keys="label")  # disabled
join = TextJoin(Text=panel)
json_keys = JSONKeys(JO=join)
read_json_2 = ReadJSON(JSONObject=join, Keys=json_keys)
mindex = MemberIndex(Set=json_keys, Member=u_text_2.Values)  # -> Index, Count
paragraph = Paragraph(HAlign=1, VAlign=1, RightLeft=False)
read_json_3 = ReadJSON(JSONObject=read_json_2, Keys="font-size")  # -> flatten(Values)
expression = Expression(x=read_json_3, y=Slider(4.509, range=0..20), Expression="x*y")
font = Font(Family="Calibri", Size=expression, Bold=False, Italic=False, Underline=False)
item = ListItem(List=font, Index=mindex.Index, Wrap=True)
textc = TextCurves(Plane=xy, Text=u_text_3.Values, Font=item, Paragraph=paragraph)
boundary = BoundarySurfaces(Edges=textc)
debrep = DeconstructBrep(Brep=boundary)  # -> Faces, Edges, Vertices
join_2 = JoinCurves(Curves=debrep.Edges, Preserve=False)
len = Length(Curve=join_2)
sort = SortList(Keys=len, ValuesA=join_2)  # -> Keys, simplify(ValuesA)
cull_i = CullIndex(List=sort.ValuesA, Indices=0, Wrap=True)
item_2 = ListItem(List=sort.ValuesA, Index=0, Wrap=True)
xy_2 = XYPlane(Origin=Point(0, 0, 0))
topoly = CurveToPolyline(Curve=item_2, ToleranceDistance=0.1, ToleranceAngle=0)  # -> Polyline, Segments
svg_layout = SVGLayout(P=xy_2, D="A4", S="1:10", L=True)  # -> L, R
geo2arch = Geo2Arch(Geometry=flatten(topoly.Polyline), Properties="{}")
crv = Curve(svg_layout.R)
panel_2 = Panel(cull_i)
svg = SVGGenerator(JO=geo2arch, LA=svg_layout.L)
